# Grasshopper definition strings.gh (Grasshopper 1.0.7)

image_file = GetString(AtLeast=1, AtMost=1)
panel = Panel("da")
python = GhPythonScript(x=image_file)  # -> out, a
# ---------- python: Python ----------
import os

path = os.path.dirname(ghdoc.Path) 
os.chdir(path)

if x:
    with open("damistring.txt", 'w') as f:
        f.write(x)
# ---------- end python ----------
context_print = ContextPrint(Text=image_file)
